vi "index.gviweb"   [G Web Development Software 22.3.0]
panel controls:
  "Usuario": string
  "Contraseña": string
  "Confirm Button": bool
panel indicators:
  "Cluster": T1
  "body": string
  "URL Image_2": string
  "Tab": i32
  "Chart": f64
types:
  T1 = cluster{"Sensor Value": f64, "Connection": bool, "Calibration data": string}
uses:
  NI::HTTP::Open HTTP Handle.gvi
  NI::HTTP::GET.gvi
  NI::HTTP::Close HTTP Handle.gvi
diagram:
  sequence {
    frame 0 {
      Property Node(instance in=reference to "Usuario", "Value"="")
      Property Node(instance in=reference to "Contraseña", "Value"="")
      $Tab <- 0
    }
  }
  call "Open HTTP Handle.gvi"(error in=no error) -> (client handle out=w1, error out=w2)
  # Top-Level WebVIs usually contain a While Loop that never stops so that they can continue running as long as the web page is open in the user's web browser.
  s1 = w1  # shift register
  s2 = w2  # shift register
  s3 = FALSE  # shift register
  while {
    Wait(time to wait=50)
    w3 = "https://ge-iot-ad599-default-rtdb.firebaseio.com/access.json"
    call "GET.gvi"(client handle=s1, url=w3, error in=s2) -> (client handle out=w4, body=w5, error out=w6)
    w7 = cluster{"user": string, "password": string} {all zero or empty}
    Unflatten From Json(JSON string=w5, type and defaults=w7) -> (value=w8)
    case ($"Confirm Button") {
      frame False, Default {
        w9 = s3
      }
      frame True {
        Property Node(instance in=w8) -> ("user"=w10, "password"=w11)
        Is Equal(x=$Usuario, y=w10) -> w12
        Is Equal(x=w11, y=$Contraseña) -> w13
        Logical And(w12, w13) -> w9
      }
    }
    case (w9) {
      frame False, Default {
        w14 = w4
        w15 = w6
      }
      frame True {
        $Tab <- 1
        call "GET.gvi"(client handle=w4, url="https://ge-iot-ad599-default-rtdb.firebaseio.com/data.json", error in=w6) -> (client handle out=w14, body=w16, error out=w15)
        $body <- w16
        Unflatten From Json(JSON string=w16, type and defaults=T1 {all zero or empty}) -> (value=w17)
        $Cluster <- w17
        Property Node(instance in=w17) -> ("Sensor Value"=w18)
        $Chart <- w18
      }
    }
    next s1 = w14
    next s2 = w15
    next s3 = w9
    stop if FALSE
  }
  call "Close HTTP Handle.gvi"(client handle=s1, error in=s2)
